% Simulink data dictionary demo_env_bus_types.sldd

demo_env_Controller1_Controller1_DT = Simulink.Bus()
  d1: double[2 2]
  d12: double
  log1: double

demo_env_Controller1_Controller1_PT = Simulink.Bus()
  p1: double
  p2: double
  p12: double
  p3: uint8[1 6]

demo_env_Controller1_Controller1_LT = Simulink.Bus()
  log1: double